# Grasshopper definition 0001_basic_training.gh (Grasshopper 1.0.7)

range = Range(Domain=Slider(100, range=0..100), Steps=10)
python = GhPythonScript()  # -> out, a
# ---------- python: Python ----------
a = "hello, world"
# ---------- end python ----------
python_2 = GhPythonScript(x=Slider(0.5, range=0..1), y=Slider(0.65, range=0..1))  # -> out, a
# ---------- python_2: Python ----------
a = x * y
# ---------- end python_2 ----------
python_3 = GhPythonScript(range=range)  # -> out, a; inputs range: list
# ---------- python_3: Python ----------
import rhinoscriptsyntax as rs
import Rhino.Geometry as rg

points = []

for x in range:
    for y in range:
        for z in range:
            point = rg.Point3d(x, y, z)
            points.append(point)

a = points
# ---------- end python_3 ----------
panel = Panel(python.a)
panel_2 = Panel(python_2.a)
panel_3 = Panel(python_3.a)
